# Grasshopper definition HousePacking.gh (Grasshopper 1.0.7)
# plug-ins: PlotPlanning

# ----
# Variation as a parameter to evaluate?
# House types, length spread, orientations
# 
# Ensure the vectors always point towards centre
# 
# How to flip house rows?
# 
# vad ska komma först - husen eller övriga areor (green area, parking etc)?
# Ska vi implementera forst fit på övriga areor om husen placeras först?
# 1. Create Set
# A
# B
# C
panel = Panel("""12
7""")
panel_2 = Panel("""14
9""")
panel_3 = Panel("""18
10""")
item = ListItem(List=panel, Index=0, Wrap=True)  # -> Item, Item1
item_2 = ListItem(List=panel_2, Index=0, Wrap=True)  # -> Item, Item1
item_3 = ListItem(List=panel_3, Index=0, Wrap=True)  # -> Item, Item1
rectangle = Rectangle(Plane=PlaneXY(0, 0, 0), XSize=item.Item, YSize=item.Item1, Radius=0)  # -> Rectangle, Length
rectangle_2 = Rectangle(Plane=PlaneXY(0, 0, 0), XSize=item_2.Item, YSize=item_2.Item1, Radius=0)  # -> Rectangle, Length
rectangle_3 = Rectangle(Plane=PlaneXY(0, 0, 0), XSize=item_3.Item, YSize=item_3.Item1, Radius=0)  # -> Rectangle, Length
merge = Merge(Data1=rectangle.Rectangle, Data2=rectangle_2.Rectangle, Data3=rectangle_3.Rectangle)

# ----
# 2. Select houses
# 3. Define site boundaries
number_slider = Slider(3, range=0..3)
filter = StreamFilter(
    Gate=number_slider,
    Stream0=rectangle.Rectangle,
    Stream1=rectangle_2.Rectangle,
    Stream2=rectangle_3.Rectangle,
    Stream3=merge)

lng = ListLength(List=merge)
dom = ConstructDomain(DomainStart=0, DomainEnd=lng)
random = Random(Range=dom, Number=1, Seed=Slider(1, range=0..10))
round = Round(Number=random)  # -> Nearest, Floor, Ceiling
rectangle_4 = Geometry(filter)
item_4 = ListItem(List=rectangle_4, Index=round.Nearest, Wrap=True)

item_5 = ListItem(List=rectangle_4, Index=Slider(2, range=0..10), Wrap=True)
item_6 = ListItem(List=rectangle_4, Index=Slider(3, range=0..10), Wrap=True)

minamount = Slider(6, range=0..10)
maxamount = Slider(4, range=0..10)
spacedistance = Slider(0, range=0..10)
seed = Slider(5, range=0..10)
geo = Geometry([<curve referenced from the Rhino model> x6])

cluster = Cluster(bounds=geo, rectangle=item_5, minamount=minamount, maxamount=maxamount, seed=seed, spacedist=spacedistance)  # -> pl, region, C, simplify(tanvec)
cluster_2 = Cluster(bounds=cluster.pl, rectangle=item_4, minamount=minamount, maxamount=maxamount, seed=seed, spacedist=spacedistance)  # -> pl, region, C, simplify(tanvec)
cluster_3 = Cluster(bounds=cluster_2.pl, rectangle=item_6, minamount=minamount, maxamount=maxamount, seed=seed, spacedist=spacedistance)  # -> pl, region, C, simplify(tanvec)

cluster_4 = Cluster(bounds=cluster_3.pl, rectangle=item_6, minamount=minamount, maxamount=maxamount, seed=seed, spacedist=spacedistance)  # -> pl, region, C, simplify(tanvec)

entwine = Entwine(
    Branch0X=cluster.tanvec,
    Branch1X=cluster_2.tanvec,
    Branch2X=cluster_3.tanvec,
    Branch3X=cluster_4.tanvec,
    FlattenInputs=False)  # -> simplify(Result)
entwine_2 = Entwine(
    Branch0X=cluster.region,
    Branch1X=cluster_2.region,
    Branch2X=cluster_3.region,
    Branch3X=cluster_4.region,
    FlattenInputs=False)

# ----
# OUTPUTS
housefootprint = Geometry(simplify(entwine_2))
newboundary = Geometry(cluster_4.pl)

clean = CleanTree(RemoveNulls=True, RemoveInvalid=True, RemoveEmpty=Toggle(True), Tree=housefootprint)  # -> simplify(Tree)
disc = Discontinuity(Curve=clean, Level=1)  # -> simplify(Points), Parameters
path_mapper = PathMapper(disc.Points, source="{A;B;C}", target="{A;B}")
sort_pt = SortPoints(Points=path_mapper)  # -> Points, Indices
chull = ConvexHull(Pt=sort_pt.Points)  # -> flatten(AllLines)

# ----
# Green Areas
number_slider_2 = Slider(3, range=0..10)
offset = OffsetCurve(Curve=newboundary, Distance=number_slider_2, Plane=PlaneXY(0, 0, 0), Corners=1)
smoothpline = SmoothPolyline(Polyline=offset, Strength=Slider(1, range=0..1), Times=1)
boundary = BoundarySurfaces(Edges=smoothpline)
preview = CustomPreview(Geometry=boundary, Material=ColourSwatch(SwatchColor=RGB(31, 130, 38)))

# ----
# Previews
number_slider_3 = Slider(5, range=0..10)
Z = UnitZ(Factor=number_slider_3)
area = Area(Geometry=merge)  # -> Area, Centroid
extr = Extrude(Base=housefootprint, Direction=Z)
bnd = Bounds(Numbers=area.Area)
cap = CapHoles(Brep=extr)
area_2 = Area(Geometry=housefootprint)  # -> Area, Centroid
dedomain = DeconstructDomain(Domain=bnd)  # -> Start, End
gradient = Gradient(
    LowerLimit=dedomain.Start,
    UpperLimit=dedomain.End,
    Parameter=area_2.Area,
    stops=[0.076: RGB(255, 130, 160), 0.732: RGB(220, 0, 40)])
preview_2 = CustomPreview(Geometry=cap, Material=gradient)

boundary_2 = BoundarySurfaces(Edges=simplify(housefootprint))
area_3 = Area(Geometry=boundary_2)  # -> Area, Centroid
Z_2 = UnitZ(Factor=Slider(5, range=0..10))
xy = XYPlane(Origin=area_3.Centroid)
extr_2 = Extrude(Base=entwine_2, Direction=Z_2)
deplane = DeconstructPlane(Plane=xy)  # -> Origin, XAxis, YAxis, ZAxis
cap_2 = CapHoles(Brep=extr_2)
rotate = RotateDirection(Geometry=xy, Center=area_3.Centroid, From=deplane.XAxis, To=entwine)  # -> Geometry, Transform
scale_nu = ScaleNU(Geometry=cap_2, Plane=rotate.Geometry, ScaleX=1, ScaleY=Slider(0.4, range=0..1), ScaleZ=Slider(0.6, range=0..1))  # -> Geometry, Transform
preview_3 = CustomPreview(Geometry=scale_nu.Geometry, Material=gradient)

# ----
# Trees
mesh = Mesh(<mesh referenced from the Rhino model>)
area_4 = Area(Geometry=smoothpline)  # -> Area, Centroid
bbox = BoundingBox(Content=mesh, Plane=PlaneXY(0, 0, 0))  # -> Box, Box_2
division = Division(A=area_4.Area, B=area_4.Area)
project = Project(Geometry=bbox.Box, Plane=PlaneXY(0, 0, 0))  # -> Geometry, Transform
area_5 = Area(Geometry=project.Geometry)  # -> Area, Centroid
pop2d = Populate2D(Region=smoothpline, Count=division, Seed=1)
vec2pt = Vector2Pt(PointA=area_5.Centroid, PointB=pop2d, Unitize=False)  # -> Vector, Length
move = Move(Geometry=mesh, Motion=vec2pt.Vector)  # -> Geometry, Transform
# Cull small areas
# Create new boundaries
preview_4 = CustomPreview(Geometry=move.Geometry, Material=ColourSwatch(SwatchColor=RGB(39, 84, 8)))

# ==== cluster Cluster
rectangle = ClusterInput()
spacedist = ClusterInput()
bounds = ClusterInput()
maxamount = ClusterInput()
minamount = ClusterInput()
seed = ClusterInput()

# ----
# Access Points, Rotation angl, rectangles
bounds_2 = Geometry(bounds)
bounds_3 = SegmentBounds(Bounds=bounds_2, Rectangle=rectangle, Seed=seed)  # -> AllLines, CurrentLine
createaccesspoints = PlotPlanning(Line=bounds_3.CurrentLine, MinAmount=minamount, MaxAmount=maxamount, Rectangle=rectangle, SpcaceDist=spacedist)  # -> simplify(AccessPts), TanVect
createrectangles = PlotPlanning(BaseRectangle=rectangle, Position=createaccesspoints.AccessPts, TanVector=createaccesspoints.TanVect)
cullsmallareas = CullSmallAreas(A=createrectangles, B=graft(bounds_2))  # -> simplify(Region)

# ----
# Create new boundaries
c_script = CSharpScript(x=cullsmallareas)  # -> out, A; inputs x: list of Polyline
# ---------- c_script: C# ----------
    List <Point3d> ptList = new List <Point3d>();

    foreach (var pLine in x)
    {



      if (pLine != null)
      {
        foreach (var l in pLine.GetSegments())
        {
          ptList.Add(l.From);
          ptList.Add(l.To);
        }
      }
      A = Rhino.Geometry.Point3d.SortAndCullPointList(ptList, 0.01);
    }
# ---------- end c_script ----------
chull = ConvexHull(Pt=c_script.A)
clean = CleanTree(RemoveNulls=True, RemoveInvalid=True, RemoveEmpty=False, Tree=chull)
offset = OffsetCurve(Curve=clean, Distance=Slider(12, range=0..100), Plane=PlaneXY(0, 0, 0), Corners=1)
xy = XYPlane(Origin=Point(0, 0, 0))
rdiff = RegionDifference(CurvesA=graft(bounds_2), CurvesB=offset, Plane=xy)  # -> simplify(Result)

area = Area(Geometry=rdiff)  # -> Area, Centroid
bnd = Bounds(Numbers=area.Area)
dedomain = DeconstructDomain(Domain=bnd)  # -> Start, End
equals = Equality(FirstNumber=area.Area, SecondNumber=dedomain.End)  # -> Equality, Inequality
cull = CullPattern(List=rdiff, CullPattern=equals.Equality)
disc = Discontinuity(Curve=cull, Level=1)  # -> Points, Parameters
pline = PolyLine(Vertices=disc.Points, Closed=True)

tanvec = ClusterOutput(createaccesspoints.TanVect)
region = ClusterOutput(cullsmallareas)
C = ClusterOutput(offset)
pl = ClusterOutput(pline)
